# Grasshopper definition Environment_03.09.2024.gh (Grasshopper 1.0.7)
# plug-ins: Pufferfish, Parakeet

# ----
# SPLIT STAIRCASE
number_slider = Slider(0.5, range=0..1)
ellipse = Ellipse(Plane=PlaneXY(0, 0, 0), Radius1=Slider(7, range=0..10), Radius2=Slider(4, range=0..10))  # -> Ellipse, Focus1, Focus2
negative = Negative(Value=number_slider)
pi = Pi(Factor=negative)
pi_2 = Pi(Factor=number_slider)
construct_domain = ConstructDomain(DomainStart=pi, DomainEnd=pi_2)
point_on_curve = PointOnCurve(ellipse.Ellipse, parameter=0.75)
arc = Arc(Plane=point_on_curve, Radius="5", Angle=construct_domain)  # -> Arc, Length
curve_curve = CurveCurve(CurveA=arc.Arc, CurveB=ellipse.Ellipse)  # -> Points, ParamsA, ParamsB
close_curve = CloseCurve(Curve=arc.Arc, CloseType=0, Bulge=0.5, Tolerance=0)  # -> Closed, ResultBoolean
curve_curve_2 = CurveCurve(CurveA=ellipse.Ellipse, CurveB=close_curve.Closed)  # -> Points, ParamsA, ParamsB
shatter = Shatter(Curve=arc.Arc, Parameters=curve_curve.ParamsA)
shatter_2 = Shatter(Curve=ellipse.Ellipse, Parameters=curve_curve_2.ParamsA)
seam = Seam(Curve=ellipse.Ellipse, Seam=curve_curve.ParamsB)
end_points = EndPoints(Curve=arc.Arc)  # -> Start, End
list_item = ListItem(List=shatter, Index=0, Wrap=True)  # -> Item, Item1
list_item_2 = ListItem(List=shatter_2, Index=0, Wrap=True)
construct_domain_2 = ConstructDomain(DomainStart=0, DomainEnd=Slider(0.3, range=0..1))
line = Line(StartPoint=end_points.Start, EndPoint=end_points.End)
sub_curve = SubCurve(BaseCurve=reparameterize(seam), Domain=construct_domain_2)
offset_curve = OffsetCurve(Curve=sub_curve, Distance="5", Plane=PlaneXY(0, 0, 0), Corners=1)
offset_curve_2 = OffsetCurve(Curve=list_item_2, Distance="5", Plane=PlaneXY(0, 0, 0), Corners=1)
end_points_2 = EndPoints(Curve=offset_curve_2)  # -> Start, End
line_2 = Line(StartPoint=end_points_2.End, EndPoint=curve_curve.Points)
flip_curve = FlipCurve(Curve=sub_curve)  # -> Curve, Flag
merge = Merge(Data1=line, Data2=list_item.Item1, Data3=offset_curve_2, Data4=line_2)  # -> flatten(Result)
flip_curve_2 = FlipCurve(Curve=offset_curve)  # -> Curve, Flag
boundary_surfaces = BoundarySurfaces(Edges=merge)
number_slider_2 = Slider(25, range=0..100)
number_slider_3 = Slider(0.16, range=0..1)
entwine = Entwine(Branch00=flip_curve.Curve, Branch01=flip_curve_2.Curve, FlattenInputs=True)
divide_curve = DivideCurve(Curve=entwine, Count=expr("x-1", number_slider_2), Kinks=False)  # -> Points, Tangents, Parameters
series = Series(Start=0, Step=number_slider_3, Count=number_slider_2)
expression = Expression(x=number_slider_2, y=number_slider_3, Expression="(x-1)*y")
merge_2 = Merge(Data1=offset_curve_2, Data2=list_item.Item1)
unit_z = UnitZ(Factor=series)
unit_z_2 = UnitZ(Factor=expression)
move = Move(Geometry=divide_curve.Points, Motion=unit_z)  # -> Geometry, Transform
unit_z_3 = UnitZ(Factor=expression)
explode_tree = ExplodeTree(Data=move.Geometry)  # -> Branch0, Branch1
move_2 = Move(Geometry=boundary_surfaces, Motion=unit_z_2)  # -> Geometry, Transform
line_3 = Line(StartPoint=explode_tree.Branch0, EndPoint=explode_tree.Branch1)
move_3 = Move(Geometry=merge_2, Motion=unit_z_3)  # -> Geometry, Transform
list_length = ListLength(List=move.Geometry)
list_length_2 = ListLength(List=line_3)
interpolate = Interpolate(Vertices=explode_tree.Branch0, Degree=3, Periodic=False, KnotStyle=1)  # -> Curve, Length, Domain
interpolate_2 = Interpolate(Vertices=explode_tree.Branch1, Degree=3, Periodic=False, KnotStyle=1)  # -> Curve, Length, Domain
cull_index = CullIndex(List=move.Geometry, Indices="0", Wrap=True)
cull_index_2 = CullIndex(List=move.Geometry, Indices=expr("x-1", list_length), Wrap=True)
cull_index_3 = CullIndex(List=line_3, Indices=expr("x-1", list_length_2), Wrap=True)
ruled_surface = RuledSurface(CurveA=interpolate.Curve, CurveB=interpolate_2.Curve)
merge_3 = Merge(Data1=interpolate.Curve, Data2=interpolate_2.Curve)
deconstruct = Deconstruct(Point=cull_index)  # -> XComponent, YComponent, ZComponent
deconstruct_2 = Deconstruct(Point=cull_index_2)  # -> XComponent, YComponent, ZComponent
join_curves = JoinCurves(Curves=[merge_3, move_3.Geometry], Preserve=False)
construct_point = ConstructPoint(XCoordinate=deconstruct.XComponent, YCoordinate=deconstruct.YComponent, ZCoordinate=deconstruct_2.ZComponent)
unit_z_4 = UnitZ(Factor=Slider(1.2, range=0..10))
move_to_point = MoveToPoint(Geometry=cull_index_3, PointA=cull_index, PointB=construct_point)  # -> Moved, Vector, Transform
extrude = Extrude(Base=join_curves, Direction=unit_z_4)
number_slider_4 = Slider(0.015, range=0..0.1)
flip = Flip(Surface=ruled_surface)  # -> Surface, Result
number_slider_5 = Slider(0.03, range=0..0.1)
offset_surface = OffsetSurface(Surface=[flip.Surface, move_2.Geometry], Distance=number_slider_5, BothSides=0, CreateSolid=True)
weave = Weave(Pattern=[0, 1], Stream0=move_to_point.Moved, Stream1=line_3, NullGaps=False)
offset_surface_2 = OffsetSurface(Surface=extrude, Distance=number_slider_4, BothSides=expr("-x", number_slider_4), CreateSolid=True)
loft = Loft(Curves=weave, Options={Adjust=False, Closed=False, LoftEnds=0, LoftSimp=0, LoftType=3, Rebuild=10, Refit=0.01})
unit_z_5 = UnitZ(Factor=number_slider_5)
move_4 = Move(Geometry=loft, Motion=unit_z_5)  # -> Geometry, Transform
merge_4 = Merge(Data1=move_4.Geometry, Data2=offset_surface_2, Data3=offset_surface)
mirror = Mirror(Geometry=merge_4, Plane=PlaneYZ(0, 0, 0))  # -> Geometry, Transform
custom_preview = CustomPreview(Geometry=[mirror.Geometry, merge_4], Material=ColourSwatch(SwatchColor=RGB(255, 255, 255)))

number_slider_6 = Slider(8, range=0..10)
number_slider_7 = Slider(8, range=0..10)
circle = Circle(Plane=PlaneXY(0, 0, 0), Radius=number_slider_7)
series_2 = Series(Start=0, Step="0.2", Count=number_slider_6)
panel = Panel(series_2)
offset_curve_3 = OffsetCurve(Curve=circle, Distance=panel, Corners=1)
series_3 = Series(Start="1", Step="1", Count=number_slider_6)  # -> graft(Series)
panel_2 = Panel(series_3)
divide_curve_2 = DivideCurve(Curve=offset_curve_3, Count=Slider(18, range=0..20), Kinks=False)  # -> Points, Tangents, Parameters
panel_3 = Panel("1")
rotate = Rotate(Geometry=divide_curve_2.Points, Angle=degrees(Slider(2, range=0..10)), Plane=PlaneXY(0, 0, 0))  # -> simplify(Geometry), Transform
shift_list = ShiftList(List=divide_curve_2.Points, Shift=panel_2, Wrap=True)  # -> simplify(List)
line_4 = Line(StartPoint=rotate.Geometry, EndPoint=shift_list)

number_of_staircase = Slider(15, range=0..100)
number_slider_8 = Slider(150, range=0..1000)
# INITIAL STAIRCASE
number_slider_9 = Slider(180, range=0..1000)
multiplication = Multiplication(A=number_slider_8, B=number_of_staircase)
construct_domain_3 = ConstructDomain(DomainStart=0, DomainEnd=number_slider_9)
construct_domain_4 = ConstructDomain(DomainStart=number_slider_8, DomainEnd=multiplication)
series_4 = Series(Start=0, Step=Slider(300, range=0..1000), Count=number_of_staircase)
construct_point_2 = ConstructPoint(XCoordinate=0, YCoordinate=0, ZCoordinate=0)
range = Range(Domain=construct_domain_3, Steps=10)
range_2 = Range(Domain=construct_domain_4, Steps=expr("x-1", number_of_staircase))
panel_4 = Panel(range_2)
panel_5 = Panel(series_4)
shortest_list = ShortestList(ListListA=series_4, ListListB=range_2, TrimMode=2)  # -> ListListA, ListListB
point_cylindrical = PointCylindrical(BasePlane=construct_point_2, Angle=degrees(range), Radius=Slider(3000, range=0..10000), Elevation=0)
construct_point_3 = ConstructPoint(XCoordinate=shortest_list.ListListA, YCoordinate=shortest_list.ListListB, ZCoordinate=0)
unit_y = UnitY(Factor=Slider(150, range=0..1000))
point_list = PointList(Points=point_cylindrical, Size=2)
move_5 = Move(Geometry=construct_point_3, Motion=unit_y)  # -> Geometry, Transform
split_list = SplitList(List=point_cylindrical, Index=Slider(14, range=0..100))  # -> ListA, ListB
panel_6 = Panel("""0
1""")
point = Point(split_list.ListA)
weave_2 = Weave(Pattern=panel_6, Stream0=construct_point_3, Stream1=move_5.Geometry, NullGaps=False)
panel_7 = Panel("""-1
-2""")
interpolate_3 = Interpolate(Vertices=point, Degree=3, Periodic=False, KnotStyle=1)  # -> Curve, Length, Domain
cull_index_4 = CullIndex(List=weave_2, Indices=panel_7, Wrap=True)
unit_z_6 = UnitZ(Factor=multiplication)
curve = Curve(interpolate_3.Curve)
number_slider_10 = Slider(4800, range=0..10000)
polyline = PolyLine(Vertices=cull_index_4, Closed=False)
extrude_2 = Extrude(Base=curve, Direction=unit_z_6)
point_2 = Point(cull_index_4)
surface = Surface(extrude_2)
plane_surface = PlaneSurface(Plane=PlaneXY(0, 0, 0), XSize=number_slider_10, YSize=[multiplication, number_slider_10])
surface_closest_point = SurfaceClosestPoint(Point=point_2, Surface=reparameterize(plane_surface))  # -> Point, UVPoint, Distance
xz_plane = XZPlane(Origin=Point(0, 0, 0))
mirror_2 = Mirror(Geometry=surface, Plane=xz_plane)  # -> Geometry, Transform
evaluate_surface = EvaluateSurface(Surface=reparameterize(surface), Point=surface_closest_point.UVPoint)  # -> Point, Normal, UDirection, VDirection, Frame
unit_y_2 = UnitY(Factor=Slider(9000, range=0..10000))
move_6 = Move(Geometry=mirror_2.Geometry, Motion=unit_y_2)  # -> Geometry, Transform
evaluate_surface_2 = EvaluateSurface(Surface=reparameterize(move_6.Geometry), Point=surface_closest_point.UVPoint)  # -> Point, Normal, UDirection, VDirection, Frame
point_3 = Point(evaluate_surface.Point)
polyline_2 = PolyLine(Vertices=point_3, Closed=False)
point_4 = Point(evaluate_surface_2.Point)
polyline_3 = PolyLine(Vertices=point_4, Closed=False)
loft_2 = Loft(
    Curves=[polyline_2, polyline_3],
    Options={Adjust=False, Closed=False, LoftEnds=0, LoftSimp=0, LoftType=0, Rebuild=10, Refit=0.01})

# ----
# TURRET
number_slider_11 = Slider(4, range=0..10)
polygon = Polygon(Plane=PlaneXY(0, 0, 0), Radius=Slider(8, range=0..10), Segments=Slider(5, range=0..10), FilletRadius=0)  # -> Polygon, Length
series_5 = Series(Start=0, Step=number_slider_11, Count=Slider(23, range=0..30))
unit_z_7 = UnitZ(Factor=series_5)
move_7 = Move(Geometry=polygon.Polygon, Motion=unit_z_7)  # -> Geometry, Transform
series_6 = Series(Start=0, Step=Slider(9, range=0..10), Count=Slider(21, range=0..30))
rotate_2 = Rotate(Geometry=move_7.Geometry, Angle=degrees(series_6), Plane=PlaneXY(0, 0, 0))  # -> Geometry, Transform
bounds = Bounds(Numbers=series_6)
remap_numbers = RemapNumbers(Value=series_6, Source=bounds, Target=Domain(0, 1))  # -> Mapped, Clipped
graph_mapper = GraphMapper(
    remap_numbers.Mapped,
    x0=0,
    x1=1,
    y0=0,
    y1=1,
    amplitude=0.4518379569,
    container_name="Perlin",
    decay=0.7160520554,
    frequency=0.07206040621,
    x_offset=0.5,
    y_offset=0.5)
scale = Scale(Geometry=rotate_2.Geometry, Center=Point(0, 0, 0), Factor=graph_mapper)  # -> Geometry, Transform
loft_3 = Loft(Curves=scale.Geometry, Options={Adjust=False, Closed=False, LoftEnds=0, LoftSimp=0, LoftType=0, Rebuild=10, Refit=0.01})
explode = Explode(Curve=scale.Geometry, Recursive=True)  # -> Segments, Vertices
flip_matrix = FlipMatrix(Data=explode.Vertices)
point_on_curve_2 = PointOnCurve(explode.Segments, parameter=0.5)
polyline_4 = PolyLine(Vertices=flip_matrix, Closed=False)
flip_matrix_2 = FlipMatrix(Data=point_on_curve_2)
polyline_5 = PolyLine(Vertices=flip_matrix_2, Closed=False)
data_dam = DataDam(DataDataA=[polyline_4, polyline_5], BufferDelay=10000000, BufferMode=0)
pipe = Pipe(Curve=data_dam, Radius=Slider(0.3, range=0..1), Caps=0)
geometry = Geometry([pipe, loft_3])

number_slider_12 = Slider(29, range=0..100)
# floral patterns
subd = SubD(<subd referenced from the Rhino model>)
xy_plane = XYPlane(Origin=Point(0, 0, 0))
brep = Brep(subd)
hexagonal = Hexagonal(Plane=xy_plane, Size=Slider(0.75, range=0..1), ExtentX=number_slider_12, ExtentY=number_slider_12)  # -> Cells, Points
star_pattern_ii = StarPatternII(
    BaseGrid=hexagonal.Cells,
    Angle=Slider(0.8, range=0..1),
    Factor=Slider(1, range=0..10),
    Distance=0,
    ShiftSize=2,
    AngleFactor=10)
project = Project(Curve=star_pattern_ii, Brep=brep, Direction=Vector(0, 0, 1))
unit_z_8 = UnitZ(Factor=Slider(0.1, range=0..1))
extrude_3 = Extrude(Base=project, Direction=unit_z_8)

# ----
# DOME
addition = Addition(A=number_slider_7, B=panel)
panel_8 = Panel(addition)
sphere = Sphere(Base=PlaneXY(0, 0, 0), Radius=panel_8)  # -> graft(Sphere)
scale_nu = ScaleNU(Geometry=sphere, Plane=PlaneXY(0, 0, 0), ScaleX=1, ScaleY=1, ScaleZ=Slider(1, range=0..2))  # -> Geometry, Transform
brep_plane = BrepPlane(Brep=scale_nu.Geometry, Plane=PlaneXY(0, 0, 0))  # -> Curves, Points
surface_split = SurfaceSplit(Surface=scale_nu.Geometry, Curves=brep_plane.Curves)
list_item_3 = ListItem(List=surface_split, Index=0, Wrap=True)
project_2 = Project(Curve=line_4, Brep=list_item_3, Direction=Vector(0, 0, 1))
pipe_2 = Pipe(Curve=project_2, Radius=Slider(0.08, range=0..0.1), Caps=0)
custom_preview_2 = CustomPreview(
    Geometry=pipe_2,
    Material={diffuse=RGB(221, 160, 221), emission=RGB(66, 48, 66), shine=0.5, specular=RGB(255, 255, 255), transparency=0})

geo = Geometry([loft_2, move_6.Geometry, extrude_2])

# ----
# Height of the wall
number_slider_13 = Slider(2400, range=0..10000)
construct_point_4 = ConstructPoint(XCoordinate=0, YCoordinate=0, ZCoordinate=0)
division = Division(A=number_slider_13, B=1)
point_5 = Point(construct_point_4)
number_slider_14 = Slider(5100, range=0..10000)
circle_2 = Circle(Plane=point_5, Radius=division)
boundary_surfaces_2 = BoundarySurfaces(Edges=circle_2)
offset_curve_4 = OffsetCurve(Curve=circle_2, Distance=number_slider_14, Plane=PlaneXY(0, 0, 0), Corners=1)
boundary_surfaces_3 = BoundarySurfaces(Edges=flatten([offset_curve_4, circle_2]))
end_points_3 = EndPoints(Curve=circle_2)  # -> Start, End
end_points_4 = EndPoints(Curve=offset_curve_4)  # -> Start, End
number_of_steps = Slider(25, range=0..100)
division_2 = Division(A="360", B=number_of_steps)
line_5 = Line(StartPoint=end_points_3.Start, EndPoint=end_points_4.Start)
rotate_3 = Rotate(Geometry=line_5, Angle=degrees(division_2), Plane=point_5)  # -> Geometry, Transform
number_slider_15 = Slider(150, range=0..1000)
surface_split_2 = SurfaceSplit(Surface=boundary_surfaces_3, Curves=[line_5, rotate_3.Geometry])
multiplication_2 = Multiplication(A=number_slider_15, B=number_of_steps)
list_item_4 = ListItem(List=surface_split_2, Index=0, Wrap=True)
series_7 = Series(Start=0, Step=division_2, Count=number_of_steps)
rotate_4 = Rotate(Geometry=list_item_4, Angle=degrees(series_7), Plane=PlaneXY(0, 0, 0))  # -> Geometry, Transform
unit_z_9 = UnitZ(Factor=multiplication_2)
extrude_4 = Extrude(Base=boundary_surfaces_2, Direction=unit_z_9)
negative_2 = Negative(Value=number_slider_15)
unit_z_10 = UnitZ(Factor=negative_2)

addition_2 = Addition(A=number_slider_13, B=number_slider_14)
construct_domain_5 = ConstructDomain(DomainStart=0, DomainEnd=Slider(360, range=0..1000))
construct_domain_6 = ConstructDomain(DomainStart=0, DomainEnd=multiplication_2)
multiplication_3 = Multiplication(A=number_of_steps, B=Slider(4, range=0..10))
range_3 = Range(Domain=construct_domain_6, Steps=multiplication_3)
range_4 = Range(Domain=construct_domain_5, Steps=multiplication_3)
point_cylindrical_2 = PointCylindrical(BasePlane=point_5, Angle=degrees(range_4), Radius=addition_2, Elevation=range_3)
unit_z_11 = UnitZ(Factor=Slider(1100, range=0..10000))
unit_y_3 = UnitY(Factor=Slider(50, range=0..100))

# ----
# SPIRAL STAIRCASE_OPT
number_slider_16 = Slider(160, range=0..1000)
number_slider_17 = Slider(150, range=0..1000)
number_slider_18 = Slider(15, range=0..100)
panel_9 = Panel("""-1
-2
-3
-4
-5
-6
-7
-8""")
cull_index_5 = CullIndex(List=point_cylindrical_2, Indices=panel_9, Wrap=True)
panel_10 = Panel("""-1
-2
-3
-4
-5
-6""")

interpolate_4 = Interpolate(Vertices=cull_index_5, Degree=3, Periodic=False, KnotStyle=1)  # -> Curve, Length, Domain
move_8 = Move(Geometry=interpolate_4.Curve, Motion=unit_z_11)  # -> Geometry, Transform
loft_4 = Loft(
    Curves=[interpolate_4.Curve, move_8.Geometry],
    Options={Adjust=False, Closed=False, LoftEnds=0, LoftSimp=0, LoftType=0, Rebuild=10, Refit=0.01})
pipe_3 = Pipe(Curve=move_8.Geometry, Radius=Slider(20, range=0..100), Caps=Slider(2, range=0..10))
extrude_5 = Extrude(Base=loft_4, Direction=unit_y_3)

series_8 = Series(Start=number_slider_16, Step=number_slider_16, Count=number_of_steps)
unit_z_12 = UnitZ(Factor=series_8)
move_9 = Move(Geometry=rotate_4.Geometry, Motion=unit_z_12)  # -> Geometry, Transform
extrude_6 = Extrude(Base=move_9.Geometry, Direction=unit_z_10)

cull_index_6 = CullIndex(List=extrude_6, Indices=panel_10, Wrap=True)
geometry_2 = Geometry(cull_index_6)

custom_preview_3 = CustomPreview(Geometry=extrude_5, Material=ColourSwatch(SwatchColor=RGB(120, 120, 120)))
custom_preview_4 = CustomPreview(Geometry=pipe_3, Material=ColourSwatch(SwatchColor=RGB(133, 106, 27)))
custom_preview_5 = CustomPreview(Geometry=extrude_4, Material=ColourSwatch(SwatchColor=RGB(107, 93, 93)))
custom_preview_6 = CustomPreview(Geometry=geometry_2, Material=ColourSwatch(SwatchColor=RGB(107, 53, 9)))
